# Grasshopper definition GH Planes to JSON.gh (Grasshopper 1.0.7)
# plug-ins: LunchBox

curve = Curve(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)

# ---- group: Discretize curve into planes
perp_frames = PerpFrames(Curve=curve, Count=Slider(100, range=0..101), Align=True)  # -> Frames, Parameters
deconstruct_plane = DeconstructPlane(Plane=perp_frames.Frames)  # -> Origin, XAxis, YAxis, ZAxis
rotate_3d = Rotate3D(Geometry=perp_frames.Frames, Angle="-0.5 * PI", Center=deconstruct_plane.Origin, Axis=deconstruct_plane.XAxis)  # -> Geometry, Transform

# ---- group: Export JSON of Planes
datatable = CreateDataTable(TableName="MyDataTable", TableHeaders="Plane", ValueTree=rotate_3d.Geometry)
export_json = Button()
dataset = CreateDataSet(DataSetName="MyDataSet", DataTables=datatable)
path = FilePath("C:\Users\janderson\Desktop\GH_JSON_Export.json")
json = CreateJSON(WriteJSON=export_json, FilePath=path, DataSet=dataset)
panel = Panel(json)
